# Grasshopper definition udp_receiver.gh (Grasshopper 0.9.76)
# plug-ins: Python Interpreter, horsterCameraControl, gHowl, Firefly, LunchBox

timer = Timer(TimerInterval=50, Target=udp)
udp = UDPSender(Port="8000", Pattern=0)

udp_2 = UDPReceiver(Port="8001", Pattern=0)  # -> Info, Data
panel = Panel("""Location:
Attitude:""")
split = TextSplit(Text=udp_2.Data, Separators=" ;")
landing_points = Panel("""-35.3629327,149.1620386
-35.3629330,149.1620390
-35.3629335,149.1620395
-35.3629320,149.1620380""")
sequence_order = Panel("""0
2
1
3
0""")
rep = ReplaceText(Text=split, Find=panel, RecursiveReplace=False)
split_2 = TextSplit(Text=rep, Separators=",")  # -> flatten(Result)
xy = XYPlane(Origin=Point(0, 0, 0))

# ---- group: LAT, LON to XYZ, meters
longitude_1deg = Panel("111415.13*cos(rad(Phi))+94.55*cos(rad(3*Phi))+0.12*Cos(rad(5*Phi))")
latitude_1deg = Panel("111132.09-566.05*cos(rad(2*Phi))+1.20*cos(rad(4*Phi))")
eval = Evaluate(F=longitude_1deg, Phi="-35.36")
eval_2 = Evaluate(F=latitude_1deg, Phi="-35.36")
longitude_1deg_in_meters = Panel(eval)
lat_1deg_in_meters = Panel(eval_2)

# ----
panel_2 = Panel("""lat=
lon=
alt=
is_relative=
pitch=
yaw=
roll=""")

rep_2 = ReplaceText(Text=split_2, Find=panel_2, RecursiveReplace=False)

panel_3 = Panel(rep_2)

python = PythonScript(
    udpInput=panel_3,
    inputCoord=landing_points,
    inputSeq=sequence_order,
    start=Button(),
    pause=Button(),
    resumeFlag=Button(),
    reset=Button())  # -> messageLog, robotOutFlag, droneOutCom; inputs udpInput: list, inputCoord: list, inputSeq: list, start: Boolean, pause: Boolean, resumeFlag: Boolean, reset: Boolean
# ---------- python: Python ----------
import time
messageLog = []

def XYZtoLatLonAlt(point): #convert inputPoint from XYZ to Lat, Lon, Alt coordinates
    1
def UdpParse():
    print 'input = ' , udpInput 
    lat = udpInput[0]
    lon = udpInput[1]
    alt = udpInput[2]
    pitch = udpInput[4]
    yaw = udpInput[5]
    roll = udpInput[6]
    return(lat,lon,alt,roll,pitch,yaw)

#if START turns true begin running MAIN LOOP
if start:
    homePos = inputCoord[0]#set first inputCoord location as homePosition
    for item in inputSeq: ###MAIN LOOP### - runs through the inputPoints list
        print 'coordinate: ', inputCoord[int(item)]
        messageLog.append('next coordinate - '+ str(inputCoord[int(item)]))

        ###TRAVEL SEQUENCE### - deals with one drone travel sequence
        curLat,curLon,curAlt,roll,pitch,yaw = UdpParse()#parse the udpInput
        
        
        """
        droneOutCom = 'ARMED true' #arm
        messageLog.append('Arming Vehicle...')
        
        #define curWpAlt - extract from inputPoint[i]
        droneOutCom = 'TAKEOFF curWpAlt' #takeoff
        
        #send goto command to next waypoint
        XYZtoLatLonAlt(inputPoint[i+1])
        #define wpLat, wpLon, wpAlt
        droneOutCom = 'GO_TO wpLat wpLon wpAlt'
        
        #land
        droneOutCom = 'LAND'
        
        #disarm
        droneOutCom = 'ARMED false'
        """
        
        #wait until resumeFlag turns TRUE
# ---------- end python ----------
panel_4 = Panel(python.messageLog)
panel_5 = Panel(python.droneOutCom)
item = ListItem(List=panel_3, Index=0, Wrap=True)  # -> Item, Item1, Item2, Item3, Item4, Item5, Item6

# ---- group: LAT, LON to XYZ, meters (continued)
multiplication = Multiplication(A=lat_1deg_in_meters, B=item.Item)
multiplication_2 = Multiplication(A=longitude_1deg_in_meters, B=item.Item1)
pt = ConstructPoint(XCoordinate=multiplication_2, YCoordinate=multiplication, ZCoordinate=item.Item2)

# ---- group: offset
vec = Vector(Vector(-13549596.79, 3923343.485, -543.8499756))
move = Move(Geometry=pt, Motion=vec)  # -> Geometry, Transform

# ---- group: distance to origin
dist = Distance(PointA=Point(0, 0, 0), PointB=move.Geometry)
panel_6 = Panel(dist)

# ---- group: smooth location
cluster = Cluster(P=move.Geometry)

# ---- group: display rotation
xy_2 = XYPlane(Origin=Point(0, 0, 0))
deplane = DeconstructPlane(Plane=xy_2)  # -> Origin, XAxis, YAxis, ZAxis
box = CenterBox(Base=xy_2, X=0.4, Y=0.4, Z=0.1)

# ---- group: display rotation / yaw
rot3d = Rotate3D(Geometry=xy_2, Angle=expr("x*-1", item.Item5), Center=Point(0, 0, 0), Axis=deplane.ZAxis)  # -> Geometry, Transform

# ---- group: display rotation (continued)
deplane_2 = DeconstructPlane(Plane=rot3d.Geometry)  # -> Origin, XAxis, YAxis, ZAxis

# ---- group: display rotation / roll
rot3d_2 = Rotate3D(Geometry=rot3d.Geometry, Angle=item.Item6, Center=Point(0, 0, 0), Axis=deplane_2.YAxis)  # -> Geometry, Transform

# ---- group: display rotation (continued)
deplane_3 = DeconstructPlane(Plane=rot3d_2.Geometry)  # -> Origin, XAxis, YAxis, ZAxis

# ---- group: display rotation / pitch
rot3d_3 = Rotate3D(Geometry=rot3d_2.Geometry, Angle=item.Item4, Center=Point(0, 0, 0), Axis=deplane_3.XAxis)  # -> Geometry, Transform

# ---- group: display rotation (continued)
pl_origin = PlaneOrigin(Base=rot3d_3.Geometry, Origin=xy)
orient = Orient(Geometry=box, Source=xy_2, Target=pl_origin)  # -> Geometry, Transform

# ---- group: POINT TRAIL
blink = BinaryBlink(BlinkPattern=100, Start=Toggle(False), Repeat=True)
pt_2 = Point(pl_origin)
bake = ObjectBake(
    BakeToggle=blink,
    GeometryObjects=pt_2,
    Layer="GH_Bake",
    ObjectName="GH_Obj",
    ObjectColor=RGB(255, 255, 255),
    LayerColor=RGB(255, 255, 255))
panel_7 = Panel(blink)

# ---- group: camera
deplane_4 = DeconstructPlane(Plane=pl_origin)  # -> Origin, XAxis, YAxis, ZAxis
pl_origin_2 = PlaneOrigin(Base=rot3d.Geometry, Origin=deplane_4.Origin)
vdis = VectorDisplay(Anchor=deplane_4.Origin, Vector=deplane_4.YAxis)
deplane_5 = DeconstructPlane(Plane=pl_origin_2)  # -> Origin, XAxis, YAxis, ZAxis
eval_3 = Evaluate(F="V*amp*scale", V=deplane_5.ZAxis, amp=Slider(1, range=-1..1), scale=Slider(2, range=1..10))
eval_4 = Evaluate(F="V*amp*scale", V=deplane_5.YAxis, amp=Slider(-1, range=-1..1), scale=Slider(10, range=1..10))
ma = MassAddition(Input=[eval_4, eval_3, deplane_5.XAxis])  # -> Result, PartialResults
move_2 = Move(Geometry=deplane_4.Origin, Motion=ma.Result)  # -> Geometry, Transform
camera_view = BooleanToggle(False)
num = Number(30)

# ---- group: camera / smooth location
cluster_2 = Cluster(P=move_2.Geometry)

cluster_3 = Cluster(P=deplane_4.Origin)

# ---- group: camera (continued)
setcam = SetCamera(CameraLocation=cluster_2, TargetLocation=cluster_3, LensLength=num, UpDirection=deplane_4.ZAxis, Activate=camera_view)

# ==== cluster Cluster
P = ClusterInput()
pt2num = PointsToNumbers(Points=P, Mask=4)
item = ListItem(List=pt2num, Index=0, Wrap=True)  # -> Item, Item1, Item2
smoothing = SmoothingTemporal(Number=item.Item, SmoothingFactor=0.9)
smoothing_2 = SmoothingTemporal(Number=item.Item1, SmoothingFactor=0.9)
smoothing_3 = SmoothingTemporal(Number=item.Item2, SmoothingFactor=0.9)
pt2num_2 = NumbersToPoints(Numbers=[smoothing, smoothing_2, smoothing_3], Mask=4)
P_2 = ClusterOutput(pt2num_2)
